# Grasshopper definition 14-simpledragon-two-zone-run-results-csv.gh (Grasshopper 1.0.7)
# plug-ins: SimpleDragon, InvisibleDragon

window_zone_01_south = Curve(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)
window_zone_02_south = Curve(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)
run_explicit_rising_edge = Boolean(False)
cancel_active_run = Boolean(False)
zone_01_west = Brep(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)
zone_02_east = Brep(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)
overwrite_csv = Boolean(False)
force_rerun = Boolean(False)
export_csv = Boolean(False)
# Rhino source model: Open 30-two-zone-office.3dm; relink each named Brep and window to its matching local Zone cluster.
packaged_office_profile = Panel("소규모사무실")
sd_profile = LookupSimpleDragonUsageProfile(Name=packaged_office_profile)  # -> Profile, AvailableNames, Diagnostics
sd_material = SimpleDragonMaterial(Name="Simple Material", Conductivity=0.04, Density=30, SpecificHeat=1400)
envelope_0_200_m = Slider(0.2, range=0.01..0.5)
sd_construction = SimpleDragonSurfaceConstruction(Name="Simple Construction", Materials=sd_material, Thicknesses=envelope_0_200_m)  # -> Construction, UValue
sd_fenestration = SimpleDragonFenestrationConstruction(Name="Simple Window", UValue=1.5, SHGC=0.5)  # -> Construction, Transparent
sd_opening = SimpleDragonOpening(Boundary=window_zone_01_south, Name="Opening", Type=0, Construction=sd_fenestration.Construction, Blind="None")  # -> Opening, Diagnostics
sd_opening_2 = SimpleDragonOpening(Boundary=window_zone_02_south, Name="Opening", Type=0, Construction=sd_fenestration.Construction, Blind="None")  # -> Opening, Diagnostics
sd_electric_radiator = SimpleDragonElectricRadiator(Name="Electric Radiator")  # -> Supply, Diagnostics
sd_zone = SimpleDragonZone(
    ZoneBrep=zone_01_west,
    Name="Zone",
    FloorNumber=0,
    Profile=sd_profile.Profile,
    SurfaceConstruction=sd_construction.Construction,
    OpeningConstruction=sd_fenestration.Construction,
    Openings=sd_opening.Opening,
    HVAC=sd_electric_radiator.Supply,
    FloorBoundary="Ground",
    LightingPowerDensity=10)  # -> Zone, Diagnostics
sd_zone_2 = SimpleDragonZone(
    ZoneBrep=zone_02_east,
    Name="Zone",
    FloorNumber=0,
    Profile=sd_profile.Profile,
    SurfaceConstruction=sd_construction.Construction,
    OpeningConstruction=sd_fenestration.Construction,
    Openings=sd_opening_2.Opening,
    HVAC=sd_electric_radiator.Supply,
    FloorBoundary="Ground",
    LightingPowerDensity=10)  # -> Zone, Diagnostics
sd_model = SimpleDragonModel(
    Name="SimpleDragon Model",
    Zones=[sd_zone.Zone, sd_zone_2.Zone],
    NorthAxis=0,
    Address="서울특별시 종로구",
    Vintage="2020-01-01",
    MultifamilyHousing=False)  # -> GRM, Zones, Surfaces, GeometryMap, GeometryMapData, JSON, FloorArea, Diagnostics
sd_to_idf = PrepareSimpleDragonSimulation(GRM=sd_model.GRM)  # -> EnergyModel, IDF, Weather, Success, Diagnostics
geometry_provenance_map = Panel(sd_model.GeometryMap)
total_floor_area = Panel(sd_model.FloorArea)
prepared_idf = Panel(sd_to_idf.IDF)
verified_packaged_weather = Panel(sd_to_idf.Weather)
preparation_success = Panel(sd_to_idf.Success)
run_timeout_2_min = Slider(2, range=1..30)
run = RunInvisibleDragon(
    IDF=sd_to_idf.IDF,
    Weather=sd_to_idf.Weather,
    Run=run_explicit_rising_edge,
    Cancel=cancel_active_run,
    ForceRerun=force_rerun,
    Timeout=run_timeout_2_min)  # -> Result, State, Success, Diagnostics
sum = EnergyPlusResultSummary(Result=run.Result)  # -> RunID, State, Success, Warnings, Severe, Fatal, Elapsed, MonthlyTables, WorkDirectory, Diagnostics
build_grr = BuildSimpleDragonGRR(GRM=sd_model.GRM, EnergyPlusResult=run.Result)  # -> GRR, JSON, Success, Diagnostics
grr_summary = SimpleDragonGRRSummary(GRR=build_grr.GRR, Metric="SiteUses", Gross=False)  # -> TotalArea, AnnualTotal, MonthlyTotals, Carriers, CarrierTotals, EndUses, EndUseTotals, Basis
csv_export_directory = Panel("..\temp\example-preview\run-results-csv")
csv_case_id = Panel("two-zone-office")
export_csv_2 = ExportSimpleDragonCSV(
    GRR=build_grr.GRR,
    GRM=sd_model.GRM,
    Directory=csv_export_directory,
    CaseID=csv_case_id,
    Diagnostics=run.Diagnostics,
    GeometryMapData=sd_model.GeometryMapData,
    Export=export_csv,
    Overwrite=overwrite_csv)  # -> FullDirectory, FileNames, FilePaths, Content, Written
energyplus_state = Panel(run.State)
energyplus_success = Panel(run.Success)
parsed_result_success = Panel(sum.Success)
grr_build_success = Panel(build_grr.Success)
annual_site_result = Panel(grr_summary.AnnualTotal)
csv_package_files = Panel(export_csv_2.FilePaths)
csv_written = Panel(export_csv_2.Written)
